# Grasshopper definition assignment-01.gh (Grasshopper 1.0.8)

# ---- group: 01 BUILDING DISTRIBUTION
# Model overview: CLOUD CITY LAB
# A parametric floating city of towers, satellite districts and roof bridges.
# Tapered island bases, domes and spherical markers shape the composition.
building_count = Slider(6, range=3..15)
district_density = Slider(0.6, range=0.35..1)
district_size = Slider(1.03, range=0.65..1.5)
height_variation = Slider(4, range=0..6)
variation_seed = Slider(31, range=0..99)

# ---- group: 02 ISLANDS AND CURVED FORMS
island_depth = Slider(0.96, range=0.6..1.6)
orb_scale = Slider(1.07, range=0.6..1.5)
dome_height = Slider(1.21, range=0.6..1.5)

# ---- group: 03 CORE CITY AND SCALE
tower_height = Slider(5, range=3..6)
core_spread = Slider(4.46, range=0..8)
pavilion_rotation = Slider(-4.4, range=-20..25)
overall_scale = Slider(1, range=0.5..2)

# ----
# Control guide: START WITH BUILDING DISTRIBUTION
# Building count = 3 core towers + satellites.
# Density: higher values bring districts closer.
# District size changes satellite buildings and islands.
# Height variation offsets satellite elevations.
# Keep the same seed to reproduce a design.
# Quick start: QUICK START
# 1. Set count and density, then size and height.
# 2. Tune island depth, domes and core proportions.
# 3. Save a copy to keep a variant.
# Bridges follow the updated roof elevations.
# Overall scale changes the complete city.
cloud_city_lab = Python3Script(
    building_count=building_count,
    density=district_density,
    building_size=district_size,
    height_jitter=height_variation,
    seed=variation_seed,
    island_depth=island_depth,
    orb_size=orb_scale,
    dome_height=dome_height,
    levels=tower_height,
    spread=core_spread,
    twist=pavilion_rotation,
    model_scale=overall_scale)  # -> out, geometry, colors
# ---------- cloud_city_lab: Python ----------
"""CDF Assignment 01. Locate the supplied src folder and reload the geometry module.
Keep assignments and src together. Recompute after editing the Python source.
"""
import os, sys, importlib
_here = os.path.dirname(ghenv.Component.OnPingDocument().FilePath or "")
_root = _here
while _root and not os.path.isfile(os.path.join(_root, "src", "cdf", "geometry_basics.py")):
    _parent = os.path.dirname(_root)
    if _parent == _root:
        raise RuntimeError("Cannot find src/cdf/geometry_basics.py. Extract the complete submission folder first.")
    _root = _parent
_src = os.path.join(_root, "src")
if _src not in sys.path:
    sys.path.insert(0, _src)
import cdf
cdf.__path__ = [os.path.join(_src, "cdf")]
from cdf import geometry_basics
_expected = os.path.join(_src, "cdf", "geometry_basics.py")
if os.path.realpath(geometry_basics.__file__).replace(".pyc", ".py") != os.path.realpath(_expected):
    sys.modules.pop("cdf.geometry_basics", None)
    if hasattr(cdf, "geometry_basics"):
        delattr(cdf, "geometry_basics")
    from cdf import geometry_basics
geometry_basics = importlib.reload(geometry_basics)
_result = geometry_basics.create_cloud_city(building_count=building_count, density=density, building_size=building_size, height_jitter=height_jitter, seed=seed, island_depth=island_depth, orb_size=orb_size, dome_height=dome_height, levels=levels, spread=spread, twist=twist, model_scale=model_scale)
geometry = _result["geometry"]
colors = _result["colors"]
# ---------- end cloud_city_lab ----------
preview = CustomPreview(Geometry=cloud_city_lab.geometry, Material=cloud_city_lab.colors)
